# Grasshopper definition vultureDefinition.gh (Grasshopper 0.9.76)
# plug-ins: VultureGH

number_slider = Slider(10, range=0..10)
ellipse = Ellipse(Plane=PlaneXY(0, 0, 0), Radius1=Slider(10, range=0..10), Radius2=Slider(5.89, range=0..10))  # -> Ellipse, Focus1, Focus2
series = Series(Start=0, Step=Slider(5, range=0..10), Count=number_slider)
Z = UnitZ(Factor=series)
mbox = MeshBox(Base={Plane=PlaneXY(0, 0, 0), X=Domain(-10, 10), Y=Domain(-10, 10), Z=Domain(-10, 10)}, XCount=1, YCount=1, ZCount=1)
series_2 = Series(Start=0, Step=Slider(0.78, range=0..1), Count=number_slider)
move = Move(Geometry=ellipse.Ellipse, Motion=Z)  # -> Geometry, Transform
rotate = Rotate(Geometry=mbox, Angle=Slider(8.31, range=0..10), Plane=PlaneXY(0, 0, 0))  # -> Geometry, Transform
X = UnitX(Factor=Slider(48, range=0..100))
brep = Brep()
rotate_2 = Rotate(Geometry=move.Geometry, Angle=series_2, Plane=PlaneXY(0, 0, 0))  # -> Geometry, Transform
move_2 = Move(Geometry=rotate.Geometry, Motion=X)  # -> Geometry, Transform
loft = Loft(
    Curves=rotate_2.Geometry,
    Options={Adjust=False, Closed=False, LoftEnds=0, LoftSimp=0, LoftType=0, Rebuild=10, Refit=0.01})
cap = CapHoles(Brep=loft)
tri = Triangulate(Mesh=cap)  # -> Mesh, Count
tri_2 = Triangulate(Mesh=move_2.Geometry)  # -> Mesh, Count
timer = Timer(TimerInterval=20, Target=vulture)
vulture = VultureGH(
    Mesh=flatten([tri.Mesh, tri_2.Mesh]),
    Points=Point(0, 0, 0),
    Integer=0,
    Path="C:\Dropbox\# WORK\VVVVulture\Sample File\",
    SendCam=Toggle(True),
    Enable=Toggle(True))
